# Grasshopper definition image sample 1.gh (Grasshopper 1.0.7)

number_slider = Slider(15, range=0..100)
pt = ConstructPoint(XCoordinate=0, YCoordinate=0, ZCoordinate=0)
rectangle = Rectangle(Plane=pt, XSize=number_slider, YSize=number_slider, Radius=0)  # -> Rectangle, Length
arrrec = RectangularArray(Geometry=pt, Cell=rectangle.Rectangle, XCount=Slider(30, range=0..150), YCount=Slider(30, range=0..150))  # -> Geometry, Transform
bbox = BoundingBox(Content=arrrec.Geometry, Plane=PlaneXY(0, 0, 0), UnionBox=True)  # -> Box, Box_2
rectangle_2 = Rectangle(Plane=arrrec.Geometry, XSize=number_slider, YSize=number_slider, Radius=0)  # -> Rectangle, Length
srf_cp = SurfaceClosestPoint(Point=arrrec.Geometry, Surface=reparameterize(bbox.Box_2))  # -> Point, UVPoint, Distance
image = ImageSampler(
    srf_cp.UVPoint,
    FilePath="C:\Users\stuar\Desktop\seed0185.png",
    Filter="Colour",
    Interpolate=False,
    Umax=1,
    Umin=0,
    Vmax=1,
    Vmin=0,
    Wrap=1)
image_2 = ImageSampler(
    srf_cp.UVPoint,
    FilePath="C:\Users\stuar\Desktop\depth map.jpg",
    Filter="Colour",
    Interpolate=False,
    Umax=1,
    Umin=0,
    Vmax=1,
    Vmin=0,
    Wrap=1)
list = ValueList({"Standard": 0, "Inverted": 1}, selected="Standard")
# You can define individual values
# or large groups of values in each
# parameter object.
dom = ConstructDomain(DomainStart=Slider(150, range=0..300), DomainEnd=Slider(0, range=0..300))
remap = RemapNumbers(Value=image_2, Source=Domain(0, 1), Target=dom)  # -> Mapped, Clipped

# ---- group: Define a circle through 3 points
pt_2 = Point(Point(0, 10, 0))
pt_3 = Point(Point(15, 20, 0))
pt_4 = Point(Point(15, 5, 0))
circle = Circle3Pt(PointA=pt_2, PointB=pt_4, PointC=pt_3)  # -> Circle, Plane, Radius

# ----
expression = Expression(x=image_2, y=list, Expression="abs(y-x)")

# ---- group: Define a cloud of points
pt_5 = Point([Point(19.83155331, 20.37749236, 0), Point(21.98991699, 20.88534263, 0), Point(22.1930571, 19.51414689, 0), Point(20.77107632, 19.46336186, 0), Point(21.73599185, 18.57462387, 0), Point(23.18336514, 20.04738968, 0)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])

# ----
boxrec = BoxRectangle(Rectangle=rectangle_2.Rectangle, Height=remap.Mapped)

# ---- group: Measure deviation for each point
crv_cp = CurveClosestPoint(Point=pt_5, Curve=circle.Circle)  # -> Point, Parameter, Distance

# ----
preview = CustomPreview(Geometry=boxrec, Material=image)

# ---- group: Format and display average deviation inside the circle
avr = Average(Input=crv_cp.Distance)
format = Format(Format="{0:0.00} mm", Culture=127, Data0=avr)
pt_6 = Point(circle.Circle)
# The DISPLAY tab contains various components
# for visualising data both in Rhino viewports and
# the Grasshopper canvas. But there are plug-ins
# available that offer more functionality. Be sure
# to check out www.food4rhino.com
# Text Tags can be used to display
# information in the Rhino viewport,
# instead of on the Grasshopper canvas.
# Sometimes you must sort, reverse,
# re-order or cull values before you can
# meaningfully display them.
# The MATHS and SETS tabs contain
# many components for statistical and
# logical operations on data.
tag = TextTag3D(Location=pt_6, Text=format, Size=1.5, Justification=5)

# ---- group: Sort all distances and graph them
sort = SortList(Keys=crv_cp.Distance)  # -> Keys, ValuesA
graph = QuickGraph(sort.Keys, SortOrder=0)

# ---- group: Bar graph of distances
bar_graph = BarGraph(crv_cp.Distance, BarColor=RGB(255, 0, 90))
