# Grasshopper definition image sample 2.gh (Grasshopper 1.0.7)

number_slider = Slider(15, range=0..100)
number_slider_2 = Slider(30, range=0..150)
number_slider_3 = Slider(30, range=0..150)
pt = ConstructPoint(XCoordinate=0, YCoordinate=0, ZCoordinate=0)
rectangle = Rectangle(Plane=pt, XSize=number_slider, YSize=number_slider, Radius=0)  # -> Rectangle, Length
arrrec = RectangularArray(Geometry=pt, Cell=rectangle.Rectangle, XCount=number_slider_3, YCount=number_slider_2)  # -> Geometry, Transform
bbox = BoundingBox(Content=arrrec.Geometry, Plane=PlaneXY(0, 0, 0), UnionBox=True)  # -> Box, Box_2
rectangle_2 = Rectangle(Plane=arrrec.Geometry, XSize=number_slider, YSize=number_slider, Radius=0)  # -> Rectangle, Length
srf_cp = SurfaceClosestPoint(Point=arrrec.Geometry, Surface=reparameterize(bbox.Box_2))  # -> Point, UVPoint, Distance
pdecon = Deconstruct(Point=arrrec.Geometry)  # -> XComponent, YComponent, ZComponent
image = ImageSampler(
    srf_cp.UVPoint,
    FilePath="C:\Users\stuar\Desktop\seed0185.png",
    Filter="Colour",
    Interpolate=False,
    Umax=1,
    Umin=0,
    Vmax=1,
    Vmin=0,
    Wrap=1)
image_2 = ImageSampler(
    srf_cp.UVPoint,
    FilePath="C:\Users\stuar\Desktop\depth map.jpg",
    Filter="Colour",
    Interpolate=False,
    Umax=1,
    Umin=0,
    Vmax=1,
    Vmin=0,
    Wrap=1)
list = ValueList({"Standard": 0, "Inverted": 1}, selected="Standard")
dom = ConstructDomain(DomainStart=Slider(150, range=0..300), DomainEnd=Slider(0, range=0..300))
remap = RemapNumbers(Value=image_2, Source=Domain(0, 1), Target=dom)  # -> Mapped, Clipped
pt_2 = ConstructPoint(XCoordinate=pdecon.XComponent, YCoordinate=pdecon.YComponent, ZCoordinate=remap.Mapped)
srfgrid = SurfaceFromPoints(Points=pt_2, UCount=number_slider_2, Interpolate=False)
divide = DivideDomain²(Domain=srfgrid, UCount=number_slider_2, VCount=number_slider_3)
expression = Expression(x=image_2, y=list, Expression="abs(y-x)")
subsrf = Isotrim(Surface=srfgrid, Domain=divide)
division = Division(A=remap.Mapped, B=Slider(5, range=5..20))  # disabled
boxrec = BoxRectangle(Rectangle=rectangle_2.Rectangle, Height=remap.Mapped)
cir = Circle(Plane=arrrec.Geometry, Radius=division)
preview = CustomPreview(Geometry=subsrf, Material=image)

# ---- group: Define a cloud of points
pt_3 = Point([Point(19.83155331, 20.37749236, 0), Point(21.98991699, 20.88534263, 0), Point(22.1930571, 19.51414689, 0), Point(20.77107632, 19.46336186, 0), Point(21.73599185, 18.57462387, 0), Point(23.18336514, 20.04738968, 0)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])  # disabled

# ---- group: Define a circle through 3 points
pt_4 = Point(Point(15, 20, 0))  # disabled
pt_5 = Point(Point(15, 5, 0))  # disabled
pt_6 = Point(Point(0, 10, 0))  # disabled
circle = Circle3Pt(PointA=pt_6, PointB=pt_5, PointC=pt_4)  # -> Circle, Plane, Radius; disabled

# ---- group: Measure deviation for each point
crv_cp = CurveClosestPoint(Point=pt_3, Curve=circle.Circle)  # -> Point, Parameter, Distance; disabled

# ---- group: Bar graph of distances
# The DISPLAY tab contains various components
# for visualising data both in Rhino viewports and
# the Grasshopper canvas. But there are plug-ins
# available that offer more functionality. Be sure
# to check out www.food4rhino.com
bar_graph = BarGraph(crv_cp.Distance, BarColor=RGB(255, 0, 90))  # disabled

# ---- group: Format and display average deviation inside the circle
panel = Panel("{0:0.00} mm")  # disabled
avr = Average(Input=crv_cp.Distance)  # disabled
format = Format(Format=panel, Culture=127, Data0=avr)  # disabled
pt_7 = Point(circle.Circle)  # disabled
tag = TextTag3D(Location=pt_7, Text=format, Size=1.5, Justification=5)  # disabled

# ----
sort = SortList(Keys=crv_cp.Distance)  # -> Keys, ValuesA; disabled
# You can define individual values
# or large groups of values in each
# parameter object.
# Text Tags can be used to display
# information in the Rhino viewport,
# instead of on the Grasshopper canvas.
# Sometimes you must sort, reverse,
# re-order or cull values before you can
# meaningfully display them.
# The MATHS and SETS tabs contain
# many components for statistical and
# logical operations on data.
graph = QuickGraph(sort.Keys, SortOrder=0)  # disabled
